% Simulink data dictionary ESSControllerData.sldd

ActivePowerResponseOperatingParametersPU = Simulink.Bus()
  MaxExportPowerPU: double
  MaxImportPowerPU: double
  ReductionRatio: double

ActivePowerSmoothingOperatingParametersPU = Simulink.Bus()
  ActivePowerSmoothingLowDeadBandPU: double
  ActivePowerSmoothingHighDeadBandPU: double
  ActivePowerSmoothingGradientPU: double
  ActivePowerSmoothingMovAvgTimeWindow: double
  TimeStep: double

Active_ReactiveRampUp_DownData = Simulink.Bus()
  ActivePowerRampUpRatePU: double
  ActivePowerRampDownRatePU: double
  ReactivePowerRampUpRatePU: double
  ReactivePowerRampDownRatePU: double

FreqWattOperatingParametersPU = Simulink.Bus()
  FreqWattHiStartFreqPU: double
  FreqWattHiStopFreqPU: double
  FreqWattHiDischargeGradientPU: double
  FreqWattHiChargeGradientPU: double
  FreqWattLoStartFreqPU: double
  FreqWattLoStopFreqPU: double
  FreqWattLoDischargeGradientPU: double
  FreqWattLoChargeGradientPU: double
  FreqWattStartDelay: double
  FreqWattStopDelay: double

VoltVarOperatingParametersPU = Simulink.Bus()
  VoltVarHighStartingVoltagePU: double
  VoltVarHighStoppingVoltagePU: double
  VoltVarHighVoltageGradientPU: double
  VoltVarLowStartingVoltagePU: double
  VoltVarLowStoppingVoltagePU: double
  VoltVarLowVoltageGradientPU: double
  VoltVarOffsetReactivePowerPU: double

VoltWattOperatingParametersPU = Simulink.Bus()
  VoltWattHiStartVoltagePU: double
  VoltWattHiStopVoltagePU: double
  VoltWattHiDischargeGradientPU: double
  VoltWattHiChargeGradientPU: double
  VoltWattLoStartVoltagePU: double
  VoltWattLoStopVoltagePU: double
  VoltWattLoDischargeGradientPU: double
  VoltWattLoChargeGradientPU: double
  VoltWattStartDelay: double
  VoltWattStopDelay: double

ActivePowerLimitOperatingParametersPU = Simulink.Bus()
  MaxDischargingPowerPU: double
  MaxChargingPowerPU: double

WattVarOperatingParametersPU = Simulink.Bus()
  WattVarHighStartingWattagePU: double
  WattVarHighStoppingWattagePU: double
  WattVarHighWattageGradientPU: double
  WattVarLowStartingWattagePU: double
  WattVarLowStoppingWattagePU: double
  WattVarLowWattageGradientPU: double
  WattVarOffsetReactivePowerPU: double

PQCapabilityCurvePU = Simulink.Bus()
  P1PU: double
  Q1PU: double
  P2PU: double
  Q2PU: double
  P3PU: double
  Q3PU: double
  P4PU: double
  Q4PU: double
  P5PU: double
  Q5PU: double
  P6PU: double
  Q6PU: double
  P7PU: double
  Q7PU: double
  P8PU: double
  Q8PU: double

CrdChargeDischargeOperatingParametersPU = Simulink.Bus()
  SoCTarget: double
  MaxChOrDischDuration: double
  BattCapacity: double
  ActivePowerRampUpRatePU: double
  ActivePowerRampDownRatePU: double
  TimeStep: double
  ECPAppPow: double

DynamicVoltWattOperatingParametersPU = Simulink.Bus()
  DynamicVoltWattLowDeadBandPU: double
  DynamicVoltWattHighDeadBandPU: double
  DynamicVoltWattGradientPU: double
  DynamicVoltWattMovAvgTimeWindow: double
  TimeStep: double